test file "Osc1CarrierTest"

suite "Test Basic Square"
  description: Validation of OSC1 generating a square signal with different pulse widths.

  case "Square 480Hz PW 0" [baseline]
    model Alpha3, harness Osc1CarrierTestHarness (for Alpha3/Voice/DCO/Generate Sample/OSC1/Osc1Sampling/Carrier), stop time 200
    input "Osc1CarrierSquarePw0.mat", mapped to freq, p_freq_ratio, pitch, pw_percent, slope_percent (active)

  case "Square 480Hz PW 10" [baseline]
    model Alpha3, harness Osc1CarrierTestHarness (for Alpha3/Voice/DCO/Generate Sample/OSC1/Osc1Sampling/Carrier), stop time 200
    input "Osc1CarrierSquarePw10.mat", mapped to freq, p_freq_ratio, pitch, pw_percent, slope_percent (active)

  case "Square 480Hz PW 30" [baseline]
    model Alpha3, harness Osc1CarrierTestHarness (for Alpha3/Voice/DCO/Generate Sample/OSC1/Osc1Sampling/Carrier), stop time 200
    input "Osc1CarrierSquarePw30.mat", mapped to freq, p_freq_ratio, pitch, pw_percent, slope_percent (active)

  case "Square 480Hz PW 50" [baseline]
    model Alpha3, harness Osc1CarrierTestHarness (for Alpha3/Voice/DCO/Generate Sample/OSC1/Osc1Sampling/Carrier), stop time 200
    input "Osc1CarrierSquarePw50.mat", mapped to freq, p_freq_ratio, pitch, pw_percent, slope_percent (active)

  case "Square 480Hz PW 80" [baseline]
    model Alpha3, harness Osc1CarrierTestHarness (for Alpha3/Voice/DCO/Generate Sample/OSC1/Osc1Sampling/Carrier), stop time 200
    input "Osc1CarrierSquarePw80.mat", mapped to freq, p_freq_ratio, pitch, pw_percent, slope_percent (active)

  case "Square 480Hz PW 99" [baseline]
    model Alpha3, harness Osc1CarrierTestHarness (for Alpha3/Voice/DCO/Generate Sample/OSC1/Osc1Sampling/Carrier), stop time 200
    input "Osc1CarrierSquarePw99.mat", mapped to freq, p_freq_ratio, pitch, pw_percent, slope_percent (active)

  case "Square 480Hz PW 100" [baseline]
    model Alpha3, harness Osc1CarrierTestHarness (for Alpha3/Voice/DCO/Generate Sample/OSC1/Osc1Sampling/Carrier), stop time 200
    input "Osc1CarrierSquarePw100.mat", mapped to freq, p_freq_ratio, pitch, pw_percent, slope_percent (active)

suite "Test Basic Ramp"

  case "Ramp 480Hz PW 100 Slope 1" [baseline]
    model Alpha3, harness Osc1CarrierTestHarness (for Alpha3/Voice/DCO/Generate Sample/OSC1/Osc1Sampling/Carrier), stop time 200
    input "Osc1CarrierSquarePw100Slope1.mat", mapped to freq, p_freq_ratio, pitch, pw_percent, slope_percent (active)

  case "Ramp 480Hz PW 100 Slope 10" [baseline]
    model Alpha3, harness Osc1CarrierTestHarness (for Alpha3/Voice/DCO/Generate Sample/OSC1/Osc1Sampling/Carrier), stop time 200
    input "Osc1CarrierSquarePw100Slope10.mat", mapped to freq, p_freq_ratio, pitch, pw_percent, slope_percent (active)

  case "Ramp 480Hz PW 100 Slope 30" [baseline]
    model Alpha3, harness Osc1CarrierTestHarness (for Alpha3/Voice/DCO/Generate Sample/OSC1/Osc1Sampling/Carrier), stop time 200
    input "Osc1CarrierSquarePw100Slope30.mat", mapped to freq, p_freq_ratio, pitch, pw_percent, slope_percent (active)

  case "Ramp 480Hz PW 100 Slope 50" [baseline]
    model Alpha3, harness Osc1CarrierTestHarness (for Alpha3/Voice/DCO/Generate Sample/OSC1/Osc1Sampling/Carrier), stop time 200
    input "Osc1CarrierSquarePw100Slope50.mat", mapped to freq, p_freq_ratio, pitch, pw_percent, slope_percent (active)

  case "Ramp 480Hz PW 100 Slope 80" [baseline]
    model Alpha3, harness Osc1CarrierTestHarness (for Alpha3/Voice/DCO/Generate Sample/OSC1/Osc1Sampling/Carrier), stop time 200
    input "Osc1CarrierSquarePw100Slope80.mat", mapped to freq, p_freq_ratio, pitch, pw_percent, slope_percent (active)

  case "Ramp 480Hz PW 100 Slope 100" [baseline]
    model Alpha3, harness Osc1CarrierTestHarness (for Alpha3/Voice/DCO/Generate Sample/OSC1/Osc1Sampling/Carrier), stop time 200
    input "Osc1CarrierSquarePw100Slope100.mat", mapped to freq, p_freq_ratio, pitch, pw_percent, slope_percent (active)